# Grasshopper definition 02_gh_mqtt.gh (Grasshopper 1.0.7)

panel = Panel("""ITECH_COM_2022/chat
ITECH_COM_2022/status""")
panel_2 = Panel("localhost")
int = Integer("1883")
txt = Text("broker.hivemq.com")
toggle = BooleanToggle(True)
timer = Timer(TimerInterval=100, Target=sub)  # disabled
sub = GhPythonScript(setup=Button(), disconnect=Button(), host=txt, port=int, topics=panel)  # -> out, msg, msg_log, status; inputs topics: list
# ---------- sub: Python ----------
# Copyright (c) 2020 Ondrej Kyjanek <ondrej.kyjanek@gmail.com>
#
# All rights reserved. This program and the accompanying materials
# are made available under the terms of the Eclipse MIT license
# which accompanies this distribution.
#
# Contributors:
#    Ondrej Kyjanek - initial implementation

# Simple grasshopper MQTT subscriber

__author__ = "Ondrej Kyjanek"
__version__ = "2020.12.09"

import paho.mqtt.client as mqttc
import paho.mqtt.properties as properties
from collections import deque

class Callbacks(object):
    def __init__(self):
        self.queue = deque(maxlen=1)
        self.status_queue = deque(maxlen=1)
        super(Callbacks, self).__init__()

    def on_connect(self, client, userdata, flags, rc, properties=None):
        self.status_queue.append("Connected")
    
    def on_disconnect(self, client, userdata, rc, properties=None):
        self.status_queue.append("Disconnected")

    def on_message(self, client, userdata, message):
        self.queue.append(message.payload.decode("utf-8"))

    def register(self, client):
        client.on_message = self.on_message
        client.on_connect = self.on_connect
        client.on_disconnect = self.on_disconnect 

if setup and not setup_done:
    try:
        client.disconnect()
        client.loop_stop()
        client.reinitialise()
    except:
        client = mqttc.Client(protocol=mqttc.MQTTv5)
    msg_log_ = []
    client.will_set(topics[1], payload="Client disconnected")
    
    callbacks = Callbacks()
    callbacks.register(client)
    
    client.connect(host,port)
    client.loop_start()
    client.subscribe([(x,0) for x in topics])
    setup_done = True
    last_msg = None
    last_status = None
    print("Starting")
elif setup:
    print("Already started")
else:
    setup_done = False

if disconnect:
    client.disconnect()
    client.loop_stop()
    client = None

try:
    last_msg = callbacks.queue.popleft()
    msg_log_.append(last_msg)
    print("Msg received")
except IndexError:
    pass
except Exception as e:
    print(e)

try:
    last_status = callbacks.status_queue.popleft()
except IndexError:
    pass
except Exception as e:
    print(e)

msg = last_msg
msg_log = msg_log_
status = last_status
# ---------- end sub ----------
pub = GhPythonScript(setup=Button(), publish=Button(), host=txt, port=int, msg="hello from gh", topic=panel)  # -> out
# ---------- pub: Python ----------
# Copyright (c) 2020 Ondrej Kyjanek <ondrej.kyjanek@gmail.com>
#
# All rights reserved. This program and the accompanying materials
# are made available under the terms of the Eclipse MIT license
# which accompanies this distribution.
#
# Contributors:
#    Ondrej Kyjanek - initial implementation

# Simple Grasshopper MQTT publisher

__author__ = "Ondrej Kyjanek"
__version__ = "2020.12.09"

import paho.mqtt.client as mqttc
import paho.mqtt.properties as properties
from collections import deque

if setup and not setup_done:
    try:
        client.disconnect()
        client.loop_stop()
        client.reinitialise()
        print("Client reinitialized")
    except:
        print("Creating new client")
        client = mqttc.Client(protocol=mqttc.MQTTv5)
    client.connect(host,port,keepalive=10)
    client.loop_start()
    setup_done = True
    print("Starting")
elif setup:
    print("Already started")
else:
    setup_done = False

if publish:
    props = properties.Properties(properties.PacketTypes.PUBLISH)
    props.UserProperty = ("name","grasshopper")
    print(props)
    msg_info = client.publish(
        topic,
        payload=msg,
        qos=0,
        retain=False,
        properties=props
    )
# ---------- end pub ----------
panel_3 = Panel(sub.out)
panel_4 = Panel(sub.status)
panel_5 = Panel(sub.msg)
panel_6 = Panel(pub)
panel_7 = Panel(sub.msg_log)
