# Grasshopper definition 02_gh_mqtt.gh (Grasshopper 1.0.7)

sub_topics = Panel("""ITECH_COM_WS/robot/status
ITECH_COM_WS/chatroom/status""")
pub_topics = Panel("ITECH_COM_WS/chatroom/pub")

# ---- group: CONNECTION PARAMS
panel = Panel("localhost")
int = Integer("1883")
txt = Text("broker.hivemq.com")

# ----
pub_topics_2 = Panel("ITECH_COM_WS/hello")
pub_topics_3 = Panel("ITECH_COM_WS/robot/cmd")
panel_2 = Panel("ON")
disconnect = Button()
setup = Button()
publish = Button()
timer = Timer(TimerInterval=1000, Target=sub)  # disabled
publish_2 = Button()
setup_2 = Button()
sub = GhPythonScript(setup=setup, disconnect=disconnect, host=txt, port=int, topics=sub_topics)  # -> out, msg, msg_log, status; inputs topics: list
# ---------- sub: Python ----------
# Copyright (c) 2020 Ondrej Kyjanek <ondrej.kyjanek@gmail.com>
#
# Contributors:
#    Ondrej Kyjanek - initial implementation

# Simple grasshopper MQTT subscriber

__author__ = "Ondrej Kyjanek"
__version__ = "2022.11.30"

import paho.mqtt.client as mqttc
import paho.mqtt.properties as properties
from collections import deque

class Callbacks(object):
    def __init__(self):
        self.queue = deque(maxlen=1)
        self.status_queue = deque(maxlen=1)
        super(Callbacks, self).__init__()

    def on_connect(self, client, userdata, flags, rc, properties=None):
        self.status_queue.append("Connected")
    
    def on_disconnect(self, client, userdata, rc, properties=None):
        self.status_queue.append("Disconnected")

    def on_message(self, client, userdata, message):
        self.queue.append(message.payload.decode("utf-8"))

    def register(self, client):
        client.on_message = self.on_message
        client.on_connect = self.on_connect
        client.on_disconnect = self.on_disconnect 

if setup and not setup_done:
    try:
        client.disconnect()
        client.loop_stop()
        client.reinitialise()
    except:
        client = mqttc.Client(protocol=mqttc.MQTTv5)
    msg_log_ = []
    client.will_set(topics[1], payload="Client disconnected")
    
    callbacks = Callbacks()
    callbacks.register(client)
    
    client.connect(host,port)
    client.loop_start()
    client.subscribe([(x,0) for x in topics])
    setup_done = True
    last_msg = None
    last_status = None
    print("Starting")
elif setup:
    print("Already started")
else:
    setup_done = False

if disconnect:
    client.disconnect()
    client.loop_stop()
    client = None

try:
    last_msg = callbacks.queue.popleft()
    msg_log_.append(last_msg)
    print("Msg received")
except IndexError:
    pass
except Exception as e:
    print(e)

try:
    last_status = callbacks.status_queue.popleft()
except IndexError:
    pass
except Exception as e:
    print(e)

msg = last_msg
msg_log = msg_log_
status = last_status
# ---------- end sub ----------
panel_3 = Panel(sub.msg)
python = GhPythonScript(robot_status=panel_3)  # -> out, motor_values
# ---------- python: Python ----------
__author__ = "ondre"
__version__ = "2022.12.08"

import rhinoscriptsyntax as rs

motor_values = [0,0]
split_vals = robot_status.split(";")
if len(split_vals) == 4:
    motor_values[0] = int(split_vals[0])
    motor_values[1] = -int(split_vals[2])
# ---------- end python ----------
addition = Addition(A=python.motor_values, B=Slider(391, range=-2000..2000))
dispatch = Dispatch(List=addition, DispatchPattern=[True, False])  # -> ListA, ListB
panel_4 = Panel(addition)
panel_5 = Panel(python.motor_values)
pub = GhPythonScript(setup=setup_2, publish=publish_2, host=txt, port=int, msg="OFF", topic=pub_topics_2)  # -> out
# ---------- pub: Python ----------
# Copyright (c) 2020 Ondrej Kyjanek <ondrej.kyjanek@gmail.com>
#
# Contributors:
#    Ondrej Kyjanek - initial implementation

# Simple Grasshopper MQTT publisher

__author__ = "Ondrej Kyjanek"
__version__ = "2022.11.30"

import paho.mqtt.client as mqttc
import paho.mqtt.properties as properties
from collections import deque

if setup and not setup_done:
    try:
        client.disconnect()
        client.loop_stop()
        client.reinitialise()
        print("Client reinitialized")
    except:
        print("Creating new client")
        client = mqttc.Client(protocol=mqttc.MQTTv5)
    client.connect(host,port,keepalive=10)
    client.loop_start()
    setup_done = True
    print("Starting")
elif setup:
    print("Already started")
else:
    setup_done = False

if publish:
    props = properties.Properties(properties.PacketTypes.PUBLISH)
    props.UserProperty = ("name","grasshopper")
    print(props)
    msg_info = client.publish(
        topic,
        payload=msg,
        qos=0,
        retain=False,
        properties=props
    )
# ---------- end pub ----------
pub_2 = GhPythonScript(
    setup=Toggle(True),
    publish=publish,
    host=txt,
    port=int,
    target_left=dispatch.ListA,
    target_right=dispatch.ListB,
    topic=pub_topics_3)  # -> out; inputs target_left: Int32, target_right: Int32
# ---------- pub_2: Python ----------
# Copyright (c) 2020 Ondrej Kyjanek <ondrej.kyjanek@gmail.com>
#
# Contributors:
#    Ondrej Kyjanek - initial implementation

# Simple Grasshopper MQTT publisher

__author__ = "Ondrej Kyjanek"
__version__ = "2022.11.30"

import paho.mqtt.client as mqttc
import paho.mqtt.properties as properties
from collections import deque
import struct

if setup and not setup_done:
    try:
        client.disconnect()
        client.loop_stop()
        client.reinitialise()
        print("Client reinitialized")
    except:
        print("Creating new client")
        client = mqttc.Client(protocol=mqttc.MQTTv5)
    client.connect(host,port,keepalive=10)
    client.loop_start()
    setup_done = True
    print("Starting")
elif setup:
    print("Already started")
elif not setup:
    setup_done = False
    client.disconnect()
    client.loop_stop()
    print("Stopped")
else:
    setup_done = False

if publish:
    msg = bytearray(struct.pack('2i',target_left, target_right))
    print(len(msg),msg)
    msg_info = client.publish(
        topic,
        payload=msg,
        qos=1,
        retain=False
    )
# ---------- end pub_2 ----------
panel_6 = Panel(pub)
panel_7 = Panel(pub_2)
panel_8 = Panel(sub.msg_log)
panel_9 = Panel(sub.out)
panel_10 = Panel(sub.status)
