# Grasshopper definition 02_gh_mqtt_robot.gh (Grasshopper 1.0.7)

sub_topics = Panel("ITECH_COM_WS/robot/#")
publish = Button()
toggle = BooleanToggle(True)

# ---- group: CONNECTION PARAMS
int = Integer("1883")
txt = Text("192.168.0.10")

# ----
panel = Panel("250")
publish_2 = Button()
publish_3 = Button()
pub_topics = Panel("ITECH_COM_WS/robot/cmd/req")
pub = GhPythonScript(setup=toggle, publish=publish_3, host=txt, port=int, target_left="0", target_right="0", topic=pub_topics)  # -> out; inputs target_left: Int32, target_right: Int32
# ---------- pub: Python ----------
# Copyright (c) 2020 Ondrej Kyjanek <ondrej.kyjanek@gmail.com>
#
# Contributors:
#    Ondrej Kyjanek - initial implementation

# Simple Grasshopper MQTT publisher

__author__ = "Ondrej Kyjanek"
__version__ = "2022.11.30"

import paho.mqtt.client as mqttc
import paho.mqtt.properties as properties
from collections import deque
import struct
import random

if setup and not setup_done:
    try:
        client.disconnect()
        client.loop_stop()
        client.reinitialise()
        print("Client reinitialized")
    except:
        print("Creating new client")
        client = mqttc.Client(protocol=mqttc.MQTTv5)
    client.connect(host,port,keepalive=10)
    client.loop_start()
    setup_done = True
    print("Starting")
elif setup:
    print("Already started")
elif not setup:
    setup_done = False
    client.disconnect()
    client.loop_stop()
    print("Stopped")
else:
    setup_done = False

if publish:
    cmd_id = int((random.random() * 4294967294)) + 1
    msg = bytearray(struct.pack('<IB2i',cmd_id,1,target_left, target_right))
    print(len(msg),msg)
    msg_info = client.publish(
        topic,
        payload=msg,
        qos=1,
        retain=False
    )
# ---------- end pub ----------
pub_2 = GhPythonScript(setup=toggle, publish=publish_2, host=txt, port=int, distance="-500", topic=pub_topics)  # -> out; inputs distance: Int32
# ---------- pub_2: Python ----------
# Copyright (c) 2020 Ondrej Kyjanek <ondrej.kyjanek@gmail.com>
#
# Contributors:
#    Ondrej Kyjanek - initial implementation

# Simple Grasshopper MQTT publisher

__author__ = "Ondrej Kyjanek"
__version__ = "2022.11.30"

import paho.mqtt.client as mqttc
import paho.mqtt.properties as properties
from collections import deque
import struct
import random

if setup and not setup_done:
    try:
        client.disconnect()
        client.loop_stop()
        client.reinitialise()
        print("Client reinitialized")
    except:
        print("Creating new client")
        client = mqttc.Client(protocol=mqttc.MQTTv5)
    client.connect(host,port,keepalive=10)
    client.loop_start()
    setup_done = True
    print("Starting")
elif setup:
    print("Already started")
elif not setup:
    setup_done = False
    client.disconnect()
    client.loop_stop()
    print("Stopped")
else:
    setup_done = False

if publish:
    cmd_id = int((random.random() * 4294967294)) + 1
    msg = bytearray(struct.pack('<IB2i',cmd_id,3,distance,0))
    print(len(msg),msg)
    msg_info = client.publish(
        topic,
        payload=msg,
        qos=1,
        retain=False
    )
# ---------- end pub_2 ----------
pub_3 = GhPythonScript(setup=toggle, publish=publish, host=txt, port=int, angle="500", topic=pub_topics)  # -> out; inputs angle: Int32
# ---------- pub_3: Python ----------
# Copyright (c) 2020 Ondrej Kyjanek <ondrej.kyjanek@gmail.com>
#
# Contributors:
#    Ondrej Kyjanek - initial implementation

# Simple Grasshopper MQTT publisher

__author__ = "Ondrej Kyjanek"
__version__ = "2022.11.30"

import paho.mqtt.client as mqttc
import paho.mqtt.properties as properties
from collections import deque
import struct
import random

if setup and not setup_done:
    try:
        client.disconnect()
        client.loop_stop()
        client.reinitialise()
        print("Client reinitialized")
    except:
        print("Creating new client")
        client = mqttc.Client(protocol=mqttc.MQTTv5)
    client.connect(host,port,keepalive=10)
    client.loop_start()
    setup_done = True
    print("Starting")
elif setup:
    print("Already started")
elif not setup:
    setup_done = False
    client.disconnect()
    client.loop_stop()
    print("Stopped")
else:
    setup_done = False

if publish:
    cmd_id = int((random.random() * 4294967294)) + 1
    msg = bytearray(struct.pack('<IB2i',cmd_id,2,angle,0))
    print(len(msg),msg)
    msg_info = client.publish(
        topic,
        payload=msg,
        qos=1,
        retain=False
    )
# ---------- end pub_3 ----------
disconnect = Button()
setup = Button()
timer = Timer(TimerInterval=100, Target=sub)
panel_2 = Panel([pub_3, pub_2, pub])
sub = GhPythonScript(setup=setup, disconnect=disconnect, host=txt, port=int, topics=sub_topics)  # -> out, msg, msg_raw, msg_log, status; inputs topics: list
# ---------- sub: Python ----------
# Copyright (c) 2020 Ondrej Kyjanek <ondrej.kyjanek@gmail.com>
#
# Contributors:
#    Ondrej Kyjanek - initial implementation

# Simple grasshopper MQTT subscriber

__author__ = "Ondrej Kyjanek"
__version__ = "2022.11.30"

import paho.mqtt.client as mqttc
import paho.mqtt.properties as properties
import logging
from collections import deque
import System



class Callbacks(object):
    def __init__(self):
        self.queue = deque(maxlen=50)
        self.status_queue = deque(maxlen=50)
        super(Callbacks, self).__init__()

    def on_connect(self, client, userdata, flags, rc, properties=None):
        self.status_queue.append("Connected")
    
    def on_disconnect(self, client, userdata, rc, properties=None):
        self.status_queue.append("Disconnected")

    def on_message(self, client, userdata, message):
        self.queue.append(message)

    def register(self, client):
        client.on_message = self.on_message
        client.on_connect = self.on_connect
        client.on_disconnect = self.on_disconnect 

if setup and not setup_done:
    try:
        client.disconnect()
        client.loop_stop()
        client.reinitialise()
    except:
        client = mqttc.Client(protocol=mqttc.MQTTv311)
    msg_log_ = []
    if status_topic:
        client.will_set(topics[1], payload="Client disconnected")
    
    callbacks = Callbacks()
    callbacks.register(client)
    
    client.connect(host,port)
    client.loop_start()
    client.subscribe([(x,1) for x in topics])
    setup_done = True
    last_msg = None
    last_status = None
    print("Starting")
elif setup:
    print("Already started")
else:
    setup_done = False

if disconnect:
    try:
        client.disconnect()
        client.loop_stop()
        client = None
    except System.MissingMemberException:
        print("Already disconnected")

try:
    last_msg = callbacks.queue.popleft()
    msg_log_.append(last_msg.payload)
    if len(msg_log_) > 100:
        msg_log_.pop(0)
    print("Msg received")
except IndexError:
    pass
except Exception as e:
    print(e)

try:
    last_status = callbacks.status_queue.popleft()
except IndexError:
    pass
except Exception as e:
    print(e)

if last_msg:
    msg = last_msg.payload
    msg_raw = last_msg
msg_log = msg_log_
status = last_status
# ---------- end sub ----------
python = GhPythonScript(raw_msg=sub.msg_raw)  # -> out, payload, topic, timestamp
# ---------- python: Python ----------
__author__ = "ondre"
__version__ = "2023.01.13"

import rhinoscriptsyntax as rs

topic = raw_msg.topic
payload = raw_msg.payload
timestamp = raw_msg.timestamp
# ---------- end python ----------
tmatch = MatchText(Text=python.topic, RegEx=".*info", Case=True)
tmatch_2 = MatchText(Text=python.topic, RegEx=".*res", Case=True)
run_path = BooleanToggle(True)
repeat_path = BooleanToggle(False)
crv = Curve(<curve referenced from the Rhino model>)
crv_2 = Curve(<curve referenced from the Rhino model>)
dispatch = Dispatch(List=sub.msg_raw, DispatchPattern=tmatch)  # -> ListA, ListB
dispatch_2 = Dispatch(List=dispatch.ListB, DispatchPattern=tmatch_2)  # -> ListA, ListB
python_2 = GhPythonScript(raw_msg=sub.msg_raw)  # -> out
# ---------- python_2: Python ----------
__author__ = "ondre"
__version__ = "2023.01.13"

import rhinoscriptsyntax as rs
import struct

print(len(raw_msg.payload))
byte_payload = bytearray(raw_msg.payload)
if (raw_msg.topic.endswith("info")):
    print([hex(x) for x in struct.unpack('<{}B'.format(len(byte_payload)),byte_payload)])
# ---------- end python_2 ----------
python_3 = GhPythonScript(run=run_path, host=txt, port=int, topic=pub_topics, raw_msg=dispatch_2.ListA, polyline=crv_2, is_repeat=repeat_path)  # -> out, poly_index, polyline; inputs run: Boolean, polyline: Polyline, is_repeat: Boolean
# ---------- python_3: Python ----------
# Copyright (c) 2020 Ondrej Kyjanek <ondrej.kyjanek@gmail.com>
#
# Contributors:
#    Ondrej Kyjanek - initial implementation

# Simple Grasshopper MQTT publisher

__author__ = "Ondrej Kyjanek"
__version__ = "2022.11.30"

import Rhino.Geometry as rg

import paho.mqtt.client as mqttc
import paho.mqtt.properties as properties
from collections import deque
import struct
import random
import time
import math

TIME_LIMIT = 10
ANGLE_COEFF = 1028

def get_cmd_id():
    return int((random.random() * 4294967294)) + 1

publish = False
time_act = time.time()
is_closed = polyline.IsClosed
polyline = list(polyline)
if (is_closed):
    polyline.append(polyline[1])
    path_cmd_length = len(polyline)*2-2
else:
    path_cmd_length = len(polyline)*2-1

if run and not setup_done:
    try:
        client.disconnect()
        client.loop_stop()
        client.reinitialise()
        print("Client reinitialized")
    except:
        print("Creating new client")
        client = mqttc.Client(protocol=mqttc.MQTTv5)
    client.connect(host,port,keepalive=10)
    client.loop_start()
    setup_done = True
    path_cmd_index = 0
    index = 0
    cmd_send = False
    cmd_finished = True
    path_finished = False
    last_cmd_time = time.time()
    
    cmd_id = get_cmd_id()
    publish = True
    print("Starting")
elif run:
    pass
    #print("Already started")
elif not run:
    try:
        setup_done = False
        client.disconnect()
        client.loop_stop()
        print("Stopped")
    except:
        print("Already stopped")
else:
    setup_done = False

if run:
    if raw_msg:
        msg = struct.unpack('<IBB',raw_msg.payload)
        print("Received state: ",msg)
        if msg[2] == 0:
            print("ERROR")
            cmd_finished = True
            cmd_send = False
        elif msg[2] == 1:
            print("Cmd queued")
            cmd_send = False
        elif msg[2] == 2:
            print("Cmd started")
        elif msg[2] == 3:
            print("Cmd finished")
            path_cmd_index += 1
            if path_cmd_index==path_cmd_length-2:
                index = 0
                path_cmd_index = 0
                path_finished = True and (not is_repeat)
                print("Path finished")
            cmd_finished = True
            print("New cmd set: ",path_cmd_index,index)
    
    if ((not cmd_send and cmd_finished and not path_finished) or \
        (cmd_send and time_act-last_cmd_time>TIME_LIMIT)):
        cmd_finished = False
        cmd_id = get_cmd_id()
        if (path_cmd_index+1)%2 == 1: #distance
            cmd_type = 3
            cmd_value = int((polyline[index+1]-polyline[index]).Length)
        else: #angle
            cmd_type = 2
            cmd_value = rg.Vector3d.VectorAngle(
                polyline[index+1]-polyline[index],
                polyline[index+2]-polyline[index+1],
                rg.Plane.WorldXY
            )
            cmd_value = (cmd_value % (2*math.pi))
            if cmd_value>math.pi:
                cmd_value -= 2*math.pi
            cmd_value /= math.pi
            print('angle is: ',cmd_value)
            cmd_value = int(ANGLE_COEFF*cmd_value)
            index += 1
        publish = True
    print(cmd_id,cmd_type,cmd_value)

if publish:
    payload = bytearray(struct.pack('<IBii',cmd_id,cmd_type,cmd_value,0))
    last_cmd_time = time_act
    client.publish(topic,payload)
    print("Send: ",payload)
    cmd_send = True

poly_index = index
# ---------- end python_3 ----------
panel_3 = Panel(python_2)
item = ListItem(List=python_3.polyline, Index=expr("x+1", python_3.poly_index), Wrap=True)
panel_4 = Panel(sub.status)
panel_5 = Panel(sub.msg_log)
item_2 = ListItem(List=python_3.polyline, Index=python_3.poly_index, Wrap=True)
xy = XYPlane(Origin=item_2)
subtraction = Subtraction(A=item, B=item_2)
align = AlignPlane(Plane=xy, Direction=subtraction)  # -> Plane, Angle
deplane = DeconstructPlane(Plane=align.Plane)  # -> Origin, XAxis, YAxis, ZAxis
python_4 = GhPythonScript(setup=Button(), x=python_3.out)  # -> out, log; inputs x: list
# ---------- python_4: Python ----------
__author__ = "ondre"
__version__ = "2023.01.19"

if setup:
    _log = []

if _log and len(_log) >= len(x) and _log[-len(x):] != x:
    _log.extend(x)
    while len(_log)>100:
        _log.pop(0)
elif len(_log) < len(x):
    _log.extend(x)

log = _log
# ---------- end python_4 ----------
panel_6 = Panel(python_4.log)
sph = Sphere(Base=align.Plane, Radius=10)
vdisex = VectorDisplayEx(
    Point=deplane.Origin,
    Vector=expr("x*50", [deplane.XAxis, deplane.YAxis]),
    Colour=[ColourSwatch(SwatchColor=RGB(255, 0, 0)), ColourSwatch(SwatchColor=RGB(0, 255, 25))],
    Width=4)
