# Grasshopper definition 03_gh_mqtt_cmds.gh (Grasshopper 1.0.7)

sub_topics = Panel("ITECH_COM_WS/robot/info")
pub_topics = Panel("ITECH_COM_WS/robot/cmd")

# ---- group: CONNECTION PARAMS
panel = Panel("broker.hivemq.com")
int = Integer("1883")
txt = Text("192.168.0.10")

# ----
panel_2 = Panel("0")
panel_4 = Panel("hello from gh")
python = GhPythonScript(number="4095")  # -> out, packed
# ---------- python: Python ----------
__author__ = "ondre"
__version__ = "2022.12.08"

import rhinoscriptsyntax as rs
import struct

packed = struct.pack('f', number)
# ---------- end python ----------
disconnect = Button()
number_slider = Slider(644, range=-2000..2000)
setup = Button()
timer = Timer(TimerInterval=2000, Target=sub)  # disabled
publish = Button()
setup_2 = Button()
panel_5 = Panel(python.packed)
sub = GhPythonScript(setup=setup, disconnect=disconnect, host=txt, port=int, topics=sub_topics)  # -> out, msg, msg_log, status; inputs topics: list
# ---------- sub: Python ----------
# Copyright (c) 2020 Ondrej Kyjanek <ondrej.kyjanek@gmail.com>
#
# Contributors:
#    Ondrej Kyjanek - initial implementation

# Simple grasshopper MQTT subscriber

__author__ = "Ondrej Kyjanek"
__version__ = "2022.11.30"

import paho.mqtt.client as mqttc
import paho.mqtt.properties as properties
from collections import deque
import struct

class Callbacks(object):
    def __init__(self):
        self.queue = deque(maxlen=1)
        self.status_queue = deque(maxlen=1)
        super(Callbacks, self).__init__()

    def on_connect(self, client, userdata, flags, rc, properties=None):
        self.status_queue.append("Connected")
    
    def on_disconnect(self, client, userdata, rc, properties=None):
        self.status_queue.append("Disconnected")

    def on_message(self, client, userdata, message):
        byte_msg = bytearray(message.payload)
        self.queue.append(message.payload)

    def register(self, client):
        client.on_message = self.on_message
        client.on_connect = self.on_connect
        client.on_disconnect = self.on_disconnect 

if setup and not setup_done:
    try:
        client.disconnect()
        client.loop_stop()
        client.reinitialise()
    except:
        client = mqttc.Client(protocol=mqttc.MQTTv5)
    msg_log_ = []
    #client.will_set(topics[1], payload="Client disconnected")
    
    callbacks = Callbacks()
    callbacks.register(client)
    
    client.connect(host,port)
    client.loop_start()
    client.subscribe([(x,0) for x in topics])
    setup_done = True
    last_msg = None
    last_status = None
    print("Starting")
elif setup:
    print("Already started")
else:
    setup_done = False

if disconnect:
    client.disconnect()
    client.loop_stop()
    client = None

try:
    msg_bytes = callbacks.queue.popleft()
    print(msg_bytes,type(msg_bytes),len(msg_bytes))
    last_msg = struct.unpack("icic",msg_bytes)
    msg_log_.append(last_msg)
    print("Msg received")
except IndexError:
    pass
except Exception as e:
    print(e)

try:
    last_status = callbacks.status_queue.popleft()
except IndexError:
    pass
except Exception as e:
    print(e)

if (last_msg):
    msg = last_msg
    msg_log = msg_log_
status = last_status
# ---------- end sub ----------
pub = GhPythonScript(
    setup=Toggle(False),
    publish=publish,
    host=txt,
    port=int,
    target_left=number_slider,
    target_right=number_slider,
    topic=pub_topics)  # -> out; inputs target_left: Int32, target_right: Int32
# ---------- pub: Python ----------
# Copyright (c) 2020 Ondrej Kyjanek <ondrej.kyjanek@gmail.com>
#
# Contributors:
#    Ondrej Kyjanek - initial implementation

# Simple Grasshopper MQTT publisher

__author__ = "Ondrej Kyjanek"
__version__ = "2022.11.30"

import paho.mqtt.client as mqttc
import paho.mqtt.properties as properties
import struct
import binascii
from collections import deque

if setup and not setup_done:
    try:
        client.disconnect()
        client.loop_stop()
        client.reinitialise()
        print("Client reinitialized")
    except:
        print("Creating new client")
        client = mqttc.Client(protocol=mqttc.MQTTv311)
    client.connect(host,port,keepalive=10)
    client.loop_start()
    setup_done = True
    print("Started")
elif setup:
    print("Already started")
elif not setup:
    setup_done = False
    client.disconnect()
    client.loop_stop()
    print("Stopped")
else:
    setup_done = False

if publish:
    msg = bytearray(struct.pack('2i', target_left, target_right))
    print(len(msg),msg)
    msg_info = client.publish(
        topic,
        payload=msg,
        qos=2,
        retain=False
    )
    print(msg_info)
# ---------- end pub ----------
panel_6 = Panel(pub)
panel_7 = Panel(sub.msg_log)
panel_8 = Panel(sub.msg)
panel_9 = Panel(sub.out)
panel_10 = Panel(sub.status)
